# Grasshopper definition Monkey.gh (Grasshopper 1.0.7)
# plug-ins: Monkey, Human

half_list = MK_HalfList()  # -> first_half, mid, second_half; inputs l: list
# ---------- half_list: Python ----------
if not l:
    pass
else:
    length = len(l)
    mid_idx = length//2

    first_half = l[:mid_idx]
    mid = l[mid_idx]
    second_half = l[mid_idx+1:]
# ---------- end half_list ----------
renum = MK_ReNum()  # -> out
# ---------- renum: Python ----------
__author__ = "zzk"
__version__ = "2022.02.20"

import rhinoscriptsyntax as rs

if num == None:
    num = 0
if len == None:
    len = 1
out = "%0*d" % (len,num,)
# ---------- end renum ----------
replace_str = MK_ReplaceString()  # -> out; inputs lst: list
# ---------- replace_str: Python ----------
__author__ = "zzk"
__version__ = "2022.05.16"

import rhinoscriptsyntax as rs

out = []
if str is None:
    str = ''

for i in lst:
    rename = i.replace(key,str)
    out.append(rename)
# ---------- end replace_str ----------
culldup = MK_CullDuplicateList()  # -> out; inputs lst: list
# ---------- culldup: Python ----------
__author__ = "zzk"
__version__ = "2022.05.16"

import rhinoscriptsyntax as rs

out = list(dict.fromkeys(lst))
# ---------- end culldup ----------
randint = MK_Randint()  # -> N
# ---------- randint: Python ----------
__author__ = "zzk"
__version__ = "2022.02.25"

import rhinoscriptsyntax as rs
import random

random.seed(Sd)

if mn == None:
    mn = 0
if mx == None:
    mx  = mn

N = random.randint(mn,mx)
# ---------- end randint ----------
first_last = MK_FirstLast()  # -> first, mid, last; inputs L: list, n: Int32
# ---------- first_last: Python ----------
if not L:
    L = [0]
if not n:
    n = 0
mid = L[1+n:-1-n]

first = L[0+n]
last = L[-1-n]
# ---------- end first_last ----------
cullnull = CullNull()
crv = Curve([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])
loft = Loft(Curves=crv, Options={Adjust=False, Closed=False, LoftEnds=0, LoftSimp=0, LoftType=0, Rebuild=10, Refit=0.01})
pt = Point(Point(-7.147788484, -23.50705651, 0))
crv_2 = Curve(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)
list = ValueList({"Autodesk FBX (.fbx)": ".fbx", "Wavefront OBJ (.obj)": ".obj", "Rhino 3D Model (.3dm)": ".3dm", "Stereolithography (.stl)": ".stl", "3D Studio (.3ds)": ".3ds", "Collada (.dae)": ".dae"}, selected="Autodesk FBX (.fbx)")
layer_name = MK_LayerName()  # -> out_obj, Name; inputs in_obj: list of Guid
# ---------- layer_name: Python ----------
__author__ = "zzk"
__version__ = "2022.05.16"

import rhinoscriptsyntax as rs
import Rhino
import scriptcontext as sc


layerNames=[]

for n in range(len(in_obj)):
    sc.doc = Rhino.RhinoDoc.ActiveDoc
    GUID = rs.ObjectLayer(in_obj[n])
    
    # find the last layer root name
    GUIDsplit = GUID.split('::')
    layerName = GUIDsplit[-1]
    
    layerNames.append(layerName)
    sc.doc = ghdoc
out_obj = in_obj
Name = layerNames
# ---------- end layer_name ----------
crv_3 = Curve([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])
crvcontain = CurvesContainment(crvs=crv_3)  # -> outCrv, inCrv; inputs crvs: list of Curve
# ---------- crvcontain: C# usings ----------
using System.CodeDom.Compiler;
using System.Diagnostics.Eventing.Reader;
using Rhino.Geometry.Intersect;
# ---------- crvcontain: C# ----------
    List<Curve> parallelCrvs = new List<Curve>(crvs);
    List<Curve> exteriorCrvs = new List<Curve>();
    List<Curve> interiorCrvs = new List<Curve>();

    // search for curve containment
    for (int i = 0; i < crvs.Count; i++)
    {
      for (int j = i + 1; j < crvs.Count; j++)
      {
        Curve curveA = crvs[i];
        Curve curveB = crvs[j];
        CurveIntersections intersectionsA = Intersection.CurveSelf(curveA, 0.001);
        CurveIntersections intersectionsB = Intersection.CurveSelf(curveB, 0.001);
        if (intersectionsA.Count > 0 || intersectionsB.Count > 0)
        {
          Component.AddRuntimeMessage(GH_RuntimeMessageLevel.Error, "curves is self intersect, operation will not continue");
        }
        else
        {
          RegionContainment containment = Curve.PlanarClosedCurveRelationship(curveA, curveB, Plane.WorldXY, 0.001);
          switch (containment)
          {
            case RegionContainment.AInsideB:
              exteriorCrvs.Add(curveB);
              interiorCrvs.Add(curveA);

              parallelCrvs.Remove(curveA);
              parallelCrvs.Remove(curveB);
              break;
            case RegionContainment.BInsideA:
              exteriorCrvs.Add(curveA);
              interiorCrvs.Add(curveB);

              parallelCrvs.Remove(curveA);
              parallelCrvs.Remove(curveB);
              break;
            case RegionContainment.Disjoint:
              break;
            case RegionContainment.MutualIntersection:
              Component.AddRuntimeMessage(GH_RuntimeMessageLevel.Error, "Contain intersected curves!");
              break;
          }
        }
      }

    }


    exteriorCrvs.AddRange(parallelCrvs);
    inCrv = interiorCrvs;
    outCrv = exteriorCrvs;
# ---------- crvcontain: C# additional code ----------
  private bool isCrvDuplicate(Curve curveA, Curve curveB)
  {
    Point3d[] ptsA = new Point3d[4];
    Point3d[] ptsB = new Point3d[4];
    curveA.DivideByCount(5, true, out ptsA);
    curveB.DivideByCount(5, true, out ptsB);

    List<bool> results = new List<bool>();

    foreach (var ptA in ptsA)
    {
      foreach (var ptB in ptsB)
      {
        if (Math.Abs(ptA.X - ptB.X) < 0.01 && Math.Abs(ptA.Y - ptB.Y) < 0.01 && Math.Abs(ptA.Z - ptB.Z) < 0.01)
        {
          results.Add(true);
        }
        else
        {
          results.Add(false);
        }
      }
    }

    return results.Contains(false);
  }
# ---------- end crvcontain ----------
dla = DLACrawl(
    Geo=loft,
    Point=pt,
    AttractorCurve=crv_2,
    SimulationAttribute="{ \"interval\": 10, \"maxStep\": 200 }",
    Scale=1,
    AttractorWeight=0.1)
path = CreatePath(FileExtension=list)
crv_4 = Curve(crvcontain.inCrv)
base = GetBase()  # -> BaseGeo, GroundPlane, GroundCenterPoint
crv_5 = Curve(crvcontain.outCrv)
origin = MK_Origin()  # -> a
# ---------- origin: Python ----------
__author__ = "zzk"
__version__ = "2022.05.27"

import rhinoscriptsyntax as rs
import Rhino
a = rs.AddPoint(0,0,0)
# ---------- end origin ----------
export = FileExport(Mesh=loft, Path=path, Bind=True, Run=False)
brep = Brep(<brep referenced from the Rhino model>)
crvcontain_2 = CurvesContainment(Curves=crv_3)  # -> InteriorCurves, ExteriorCurves
visualizer = DLAVisualzier(DLALines=dla)  # -> Parameters, Thickness
sortbydir = SortByDirections(crv=[<geometry referenced from the Rhino model> x698])  # -> horizontal_2, vertical_2, other
layer_name_2 = MK_LayerName(in_obj=brep)  # -> out_obj, Name; inputs in_obj: list of Guid; same code as layer_name
getlayer = GetLayer(Geometry=brep)  # -> LayerName, BaseName
gradient = Gradient(
    LowerLimit=0,
    UpperLimit=1,
    Parameter=visualizer.Parameters,
    stops=[0: RGB(0, 98, 0), 0.25: RGB(81, 175, 17), 0.5: RGB(159, 198, 146), 0.75: RGB(170, 235, 41), 1: RGB(221, 255, 53)])
polymesh = PolylineMesh(PolylineSegment=0)
previewlw = CustomPreviewLineweights(Geometry=dla, Shader=gradient, Thickness=visualizer.Thickness, Absolute=False)
crv_6 = Curve([<curve referenced from the Rhino model> x2])
polymesh_2 = PolylineMesh(Polyline=crv_6, PolylineSegment=Slider(0, range=0..100))

# ==== cluster SortByDirections: Sort list of individual crvs into horizontal and vertical
crv = ClusterInput()  # Individual curve to test verticality
crv_2 = Curve(crv)

# ---- group: Z Test
curvepoint = PointOnCurve(crv_2, parameter=1)
curvepoint_2 = PointOnCurve(crv_2, parameter=0)
pdecon = Deconstruct(Point=curvepoint_2)  # -> XComponent, YComponent, ZComponent
pdecon_2 = Deconstruct(Point=curvepoint)  # -> XComponent, YComponent, ZComponent
subtraction = Subtraction(A=pdecon.ZComponent, B=pdecon_2.ZComponent)
similar = Similarity(FirstNumber=subtraction, SecondNumber=Slider(0, range=0..100), Threshold=0.1)  # -> Similarity, AbsoluteDifference

# ----
dispatch = Dispatch(List=crv_2, DispatchPattern=similar.Similarity)  # -> ListA, ListB

# ---- group: X test
crv_3 = Curve(dispatch.ListB)
curvepoint_3 = PointOnCurve(crv_3, parameter=1)
curvepoint_4 = PointOnCurve(crv_3, parameter=0)
pdecon_3 = Deconstruct(Point=curvepoint_3)  # -> XComponent, YComponent, ZComponent
pdecon_4 = Deconstruct(Point=curvepoint_4)  # -> XComponent, YComponent, ZComponent
similar_2 = Similarity(FirstNumber=pdecon_4.XComponent, SecondNumber=pdecon_3.XComponent, Threshold=0.1)  # -> Similarity, AbsoluteDifference
dispatch_2 = Dispatch(List=crv_3, DispatchPattern=similar_2.Similarity)  # -> ListA, ListB

# ---- group: Y test
crv_4 = Curve(dispatch_2.ListA)
curvepoint_5 = PointOnCurve(crv_4, parameter=1)
curvepoint_6 = PointOnCurve(crv_4, parameter=0)
pdecon_5 = Deconstruct(Point=curvepoint_5)  # -> XComponent, YComponent, ZComponent
pdecon_6 = Deconstruct(Point=curvepoint_6)  # -> XComponent, YComponent, ZComponent
similar_3 = Similarity(FirstNumber=pdecon_6.YComponent, SecondNumber=pdecon_5.YComponent, Threshold=0.1)  # -> Similarity, AbsoluteDifference
dispatch_3 = Dispatch(List=crv_4, DispatchPattern=similar_3.Similarity)  # -> ListA, ListB

# ----
horizontal = Curve(dispatch.ListA)
vertical = Curve(dispatch_3.ListA)
else = Curve(dispatch_3.ListB)
other = ClusterOutput(else)  # Neither horizontal or vertical
vertical_2 = ClusterOutput(vertical)
horizontal_2 = ClusterOutput(horizontal)

# ==== cluster CullNull
relay = ClusterInput()
null = NullItem(Item=relay)  # -> NullFlags, InvalidFlags, Description
cull = CullPattern(List=relay, CullPattern=invert(null.NullFlags))
L = ClusterOutput(cull)
