# Grasshopper definition Monkey_autosave.gh (Grasshopper 1.0.7)
# Copyright: Liljewall Arkitekter
# plug-ins: Monkey, Human

half_list = MK_HalfList()  # -> first_half, mid, second_half; inputs l: list
# ---------- half_list: Python ----------
if not l:
    pass
else:
    length = len(l)
    mid_idx = length//2

    first_half = l[:mid_idx]
    mid = l[mid_idx]
    second_half = l[mid_idx+1:]
# ---------- end half_list ----------
renum = MK_ReNum()  # -> out
# ---------- renum: Python ----------
__author__ = "zzk"
__version__ = "2022.02.20"

import rhinoscriptsyntax as rs

if num == None:
    num = 0
if len == None:
    len = 1
out = "%0*d" % (len,num,)
# ---------- end renum ----------
replace_str = MK_ReplaceString()  # -> out; inputs lst: list
# ---------- replace_str: Python ----------
__author__ = "zzk"
__version__ = "2022.05.16"

import rhinoscriptsyntax as rs

out = []
if str is None:
    str = ''

for i in lst:
    rename = i.replace(key,str)
    out.append(rename)
# ---------- end replace_str ----------
culldup = MK_CullDuplicateList()  # -> out; inputs lst: list
# ---------- culldup: Python ----------
__author__ = "zzk"
__version__ = "2022.05.16"

import rhinoscriptsyntax as rs

out = list(dict.fromkeys(lst))
# ---------- end culldup ----------
randint = MK_Randint()  # -> N
# ---------- randint: Python ----------
__author__ = "zzk"
__version__ = "2022.02.25"

import rhinoscriptsyntax as rs
import random

random.seed(Sd)

if mn == None:
    mn = 0
if mx == None:
    mx  = mn

N = random.randint(mn,mx)
# ---------- end randint ----------
first_last = MK_FirstLast()  # -> first, mid, last; inputs L: list, n: Int32
# ---------- first_last: Python ----------
if not L:
    L = [0]
if not n:
    n = 0
mid = L[1+n:-1-n]

first = L[0+n]
last = L[-1-n]
# ---------- end first_last ----------
cullnull = CullNull()
crv = Curve([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])
loft = Loft(Curves=crv, Options={Adjust=False, Closed=False, LoftEnds=0, LoftSimp=0, LoftType=0, Rebuild=10, Refit=0.01})
pt = Point(Point(-7.147788484, -23.50705651, 0))
crv_2 = Curve(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)
dla = DLACrawl(
    Geo=loft,
    Point=pt,
    AttractorCurve=crv_2,
    SimulationAttribute="{ \"interval\": 10, \"maxStep\": 200 }",
    Scale=1,
    AttractorWeight=0.1)
polysrf_to_srf = PolysurfaceToSurface()
polymesh = PolylineMesh()  # -> m; inputs pl: Polyline
# ---------- polymesh: Python ----------
import rhinoscriptsyntax as rs
import Rhino
env = ghenv.Component.Params
env.Input[0].Name = "polyline"
env.Input[0].NickName = "pl"
env.Input[0].Description = 'plug in a closed polyline'

env.Output[0].Name = 'Mesh'
env.Output[0].NickName = "m"
env.Output[0].Description = 'Output mesh'

ghenv.Component.Name = "polyline mesh"
ghenv.Component.NickName = "polymesh"


if pl is not None:
    if pl.IsClosed:
        m = Rhino.Geometry.Mesh.CreateFromClosedPolyline(pl)
    else:
        raise ValueError("Polyline is not Closed")
# ---------- end polymesh ----------
crvcontain = CurvesContainment()  # -> outCrv, inCrv; inputs crvs: list of Curve
# ---------- crvcontain: C# usings ----------
using System.CodeDom.Compiler;
using System.Diagnostics.Eventing.Reader;
using Rhino.Geometry.Intersect;
# ---------- crvcontain: C# ----------
    List<Curve> parallelCrvs = new List<Curve>(crvs);
    List<Curve> exteriorCrvs = new List<Curve>();
    List<Curve> interiorCrvs = new List<Curve>();

    // search for curve containment
    for (int i = 0; i < crvs.Count; i++)
    {
      for (int j = i + 1; j < crvs.Count; j++)
      {
        Curve curveA = crvs[i];
        Curve curveB = crvs[j];
        CurveIntersections intersectionsA = Intersection.CurveSelf(curveA, 0.001);
        CurveIntersections intersectionsB = Intersection.CurveSelf(curveB, 0.001);
        if (intersectionsA.Count > 0 || intersectionsB.Count > 0)
        {
          Component.AddRuntimeMessage(GH_RuntimeMessageLevel.Error, "curves is self intersect, operation will not continue");
        }
        else
        {
          RegionContainment containment = Curve.PlanarClosedCurveRelationship(curveA, curveB, Plane.WorldXY, 0.001);
          switch (containment)
          {
            case RegionContainment.AInsideB:
              exteriorCrvs.Add(curveB);
              interiorCrvs.Add(curveA);

              parallelCrvs.Remove(curveA);
              parallelCrvs.Remove(curveB);
              break;
            case RegionContainment.BInsideA:
              exteriorCrvs.Add(curveA);
              interiorCrvs.Add(curveB);

              parallelCrvs.Remove(curveA);
              parallelCrvs.Remove(curveB);
              break;
            case RegionContainment.Disjoint:
              break;
            case RegionContainment.MutualIntersection:
              Component.AddRuntimeMessage(GH_RuntimeMessageLevel.Error, "Contain intersected curves!");
              break;
          }
        }
      }

    }


    exteriorCrvs.AddRange(parallelCrvs);
    inCrv = interiorCrvs;
    outCrv = exteriorCrvs;
# ---------- crvcontain: C# additional code ----------
  private bool isCrvDuplicate(Curve curveA, Curve curveB)
  {
    Point3d[] ptsA = new Point3d[4];
    Point3d[] ptsB = new Point3d[4];
    curveA.DivideByCount(5, true, out ptsA);
    curveB.DivideByCount(5, true, out ptsB);

    List<bool> results = new List<bool>();

    foreach (var ptA in ptsA)
    {
      foreach (var ptB in ptsB)
      {
        if (Math.Abs(ptA.X - ptB.X) < 0.01 && Math.Abs(ptA.Y - ptB.Y) < 0.01 && Math.Abs(ptA.Z - ptB.Z) < 0.01)
        {
          results.Add(true);
        }
        else
        {
          results.Add(false);
        }
      }
    }

    return results.Contains(false);
  }
# ---------- end crvcontain ----------
sortbydir = SortByDirections(crv=[<geometry referenced from the Rhino model> x698])  # -> horizontal_2, vertical_2, other
footrec = MK_FootRec(F=0.5)
origin = MK_Origin()  # -> a
# ---------- origin: Python ----------
__author__ = "zzk"
__version__ = "2022.05.27"

import rhinoscriptsyntax as rs
import Rhino
a = rs.AddPoint(0,0,0)
# ---------- end origin ----------
visualizer = DLAVisualzier(DLALines=dla)  # -> Parameters, Thickness
layer_name = MK_LayerName()  # -> out_obj, Name; inputs in_obj: list of Guid
# ---------- layer_name: Python ----------
__author__ = "zzk"
__version__ = "2022.05.16"

import rhinoscriptsyntax as rs
import Rhino
import scriptcontext as sc


layerNames=[]

for n in range(len(in_obj)):
    sc.doc = Rhino.RhinoDoc.ActiveDoc
    GUID = rs.ObjectLayer(in_obj[n])
    
    # find the last layer root name
    GUIDsplit = GUID.split('::')
    layerName = GUIDsplit[-1]
    
    layerNames.append(layerName)
    sc.doc = ghdoc
out_obj = in_obj
Name = layerNames
# ---------- end layer_name ----------
gradient = Gradient(
    LowerLimit=0,
    UpperLimit=1,
    Parameter=visualizer.Parameters,
    stops=[0: RGB(0, 98, 0), 0.25: RGB(81, 175, 17), 0.5: RGB(159, 198, 146), 0.75: RGB(170, 235, 41), 1: RGB(221, 255, 53)])
previewlw = CustomPreviewLineweights(Geometry=dla, Shader=gradient, Thickness=visualizer.Thickness, Absolute=False)
polylinecurve = Curve(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)
nurbscrv = Curve(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)
polymesh_2 = PolylineMesh(Polyline=nurbscrv, PolylineSegment=Slider(20, range=0..100))

# ==== cluster PolysurfaceToSurface: Convert Polysurface to Surface
B = ClusterInput()
edges = BrepEdges(Brep=B)  # -> Naked, Interior, NonManifold
join = JoinCurves(Curves=edges.Naked, Preserve=False)
patch = Patch(Curves=join, Spans=20, Flexibility=1, Trim=True)
srfsplit = SurfaceSplit(Surface=patch, Curves=join)
largestsrf = LargestSurface(srfs=srfsplit)  # -> largestSrf; inputs srfs: list of Brep
# ---------- largestsrf: C# usings ----------
using System.Linq;
# ---------- largestsrf: C# ----------
    List<double> areas = GetAreas(srfs);

    largestSrf = GetLargestSrf(srfs, areas);
# ---------- largestsrf: C# additional code ----------
  private List<double> GetAreas(List<Brep> surfaces)
  {
    List<double> areas = new List<double>();
    foreach (Brep srf in surfaces)
    {
      double area = srf.GetArea();
      areas.Add(area);
    }
    areas.Sort();
    return areas;
  }

  private Brep GetLargestSrf(List<Brep> surfaces, List<double> areas)
  {
    Brep largest = new Brep();
    foreach (Brep srf in surfaces)
    {
      double area = srf.GetArea();
      if (area == areas.Last())
      {
        largest = srf;
      }
    }
    return largest;
  }
# ---------- end largestsrf ----------
largestsrf_2 = ClusterOutput(largestsrf)

# ==== cluster MK_FootRec: Find the base plane of a geometry
C = ClusterInput()

# ---- group: Box Bottom
bbox = BoundingBox(Content=C, Plane=PlaneXY(0, 0, 0))  # -> Box, Box_2
debrep = DeconstructBrep(Brep=bbox.Box)  # -> Faces, Edges, Vertices
center = Center(Geometrical=debrep.Faces)  # -> Center, Dimension
pdecon = Deconstruct(Point=center.Center)  # -> XComponent, YComponent, ZComponent
python = GhPythonScript(x=pdecon.ZComponent)  # -> a; inputs x: list
# ---------- python: Python ----------
__author__ = "zzk"
__version__ = "2022.06.08"

import rhinoscriptsyntax as rs

x.sort()

a = []

for idx, n in enumerate(x):
    if idx == 0:
        state = True
        
    else:
        state = False
    print idx
    print n
    a.append(state)
# ---------- end python ----------
sort = SortList(Keys=pdecon.ZComponent, ValuesA=debrep.Faces)  # -> Keys, ValuesA
cull = CullPattern(List=sort.ValuesA, CullPattern=python)

# ----
center_2 = Center(Geometrical=cull)  # -> Center, Dimension
F = ClusterInput()
scale = Scale(Geometry=cull, Center=center_2.Center, Factor=F)  # -> Geometry, Transform
G = ClusterOutput(scale.Geometry)

# ==== cluster SortByDirections: Sort list of individual crvs into horizontal and vertical
crv = ClusterInput()  # Individual curve to test verticality
crv_2 = Curve(crv)

# ---- group: Z Test
curvepoint = PointOnCurve(crv_2, parameter=1)
curvepoint_2 = PointOnCurve(crv_2, parameter=0)
pdecon = Deconstruct(Point=curvepoint_2)  # -> XComponent, YComponent, ZComponent
pdecon_2 = Deconstruct(Point=curvepoint)  # -> XComponent, YComponent, ZComponent
subtraction = Subtraction(A=pdecon.ZComponent, B=pdecon_2.ZComponent)
similar = Similarity(FirstNumber=subtraction, SecondNumber=Slider(0, range=0..100), Threshold=0.1)  # -> Similarity, AbsoluteDifference

# ----
dispatch = Dispatch(List=crv_2, DispatchPattern=similar.Similarity)  # -> ListA, ListB

# ---- group: X test
crv_3 = Curve(dispatch.ListB)
curvepoint_3 = PointOnCurve(crv_3, parameter=1)
curvepoint_4 = PointOnCurve(crv_3, parameter=0)
pdecon_3 = Deconstruct(Point=curvepoint_3)  # -> XComponent, YComponent, ZComponent
pdecon_4 = Deconstruct(Point=curvepoint_4)  # -> XComponent, YComponent, ZComponent
similar_2 = Similarity(FirstNumber=pdecon_4.XComponent, SecondNumber=pdecon_3.XComponent, Threshold=0.1)  # -> Similarity, AbsoluteDifference
dispatch_2 = Dispatch(List=crv_3, DispatchPattern=similar_2.Similarity)  # -> ListA, ListB

# ---- group: Y test
crv_4 = Curve(dispatch_2.ListA)
curvepoint_5 = PointOnCurve(crv_4, parameter=1)
curvepoint_6 = PointOnCurve(crv_4, parameter=0)
pdecon_5 = Deconstruct(Point=curvepoint_5)  # -> XComponent, YComponent, ZComponent
pdecon_6 = Deconstruct(Point=curvepoint_6)  # -> XComponent, YComponent, ZComponent
similar_3 = Similarity(FirstNumber=pdecon_6.YComponent, SecondNumber=pdecon_5.YComponent, Threshold=0.1)  # -> Similarity, AbsoluteDifference
dispatch_3 = Dispatch(List=crv_4, DispatchPattern=similar_3.Similarity)  # -> ListA, ListB

# ----
horizontal = Curve(dispatch.ListA)
vertical = Curve(dispatch_3.ListA)
else = Curve(dispatch_3.ListB)
other = ClusterOutput(else)  # Neither horizontal or vertical
vertical_2 = ClusterOutput(vertical)
horizontal_2 = ClusterOutput(horizontal)

# ==== cluster CullNull
relay = ClusterInput()
null = NullItem(Item=relay)  # -> NullFlags, InvalidFlags, Description
cull = CullPattern(List=relay, CullPattern=invert(null.NullFlags))
L = ClusterOutput(cull)
